% Simulink data dictionary pwmgenDictionary.sldd

PWM_FREQ = Simulink.Parameter(50000, Unit="Hz")  % PWM frequency

TYPE = enum(DefaultValue="FRONT")  % Types of PWM:
  % FRONT - Trail edge modulation
  % BACK - Lead edge modulation
  % CENTERED - Pulse center two edge modulation
  FRONT = 1
  BACK = 2
  CENTERED = 3