# Requirement set pwmProjectReqs (R2022b)

## 1 [buttons] Pushbuttons (Container)

### 1.1 [buttons_1] Quantity of pushbuttons (Informational)
There should be five buttons in the project

### 1.2 [buttons_2] Placement of the pushbuttons on the panel (Informational)
Buttons should be placed on the panel as follows:
N
W C E
S

### 1.3 [buttons_3] Functions of the pushbuttons (Container)

#### 1.3.1 [buttons_3_1] Function of N button (Informational)
Duty cycles must increase when N button is pressed

#### 1.3.2 [buttons_3_2] Function of S button (Informational)
Duty cycles must decrease when S button is pressed

#### 1.3.3 [buttons_3_3] Function of C button (Informational)
Duty cycles must set to zero when C button is pressed

#### 1.3.4 [buttons_3_4] Function of N button (Informational)
Next channel must be selected when N button is pressed

#### 1.3.5 [buttons_3_5] Function of E button (Informational)
Previous channel must be selected when N button is pressed

### 1.4 [buttons_4] Simultaneous buttonstrokes
When several buttons are pressed, system must not respond

### 1.5 [buttons_5] Single buttonstroke
When one button is pressed, system must respond

## 2 [filter] Button digital filter (Container)
Operation description
Digital filter is used in order to filter out the glitches associated with switch transitions (debouncing).

### 2.1 [filter_1] FIlter period
Module must filter out the glitches with duration less than 1 ms

## 3 [pressing_mode_handler] Pressing mode handler (Container)
Operation description
Single quick pressing of N (S) button lead to increasing (decreasing) by one current duty cycle. Holding N (S) button, after determinated period of time duty cucle must increase (decrease) automaticaly with determinated frequency

### 3.1 [pressing_mode_handler_1] Pause duration
Pause between single-pressing and continuous-pressing modes must be equal to 1 second

### 3.2 [pressing_mode_handler_2] Continuous-pressing mode frequency
Continuous-pressing mode frequency must be equal to 0.1 second

## 4 [pwm] PWM generator (Container)

### 4.1 [pwm_1] PWM
Bit capacity of PWM must be changed from 5 to 10 bits. Default value equals to 5 bits.

### 4.2 [pwm_2] Quantity of channels (Informational)
There should be three independent PWM channels

### 4.3 [pwm_3] PWM types
Three PWM types must be implemented:
1. Trailing edge modulation (back);
2. Leading edge modulation (front);
3. Centered pulses

### 4.4 [pwm_4] Synchrosignal
Module must generate synchrosignal for PWM channels

### 4.5 [pwm_5] PWM frequency
PWM frequency must be parameter. Default value equals to 1 kHz

## 5 [#30] Justifications (Justification)

### 5.1 [#31] (Justification)

### 5.2 [#32] (Justification)

### 5.3 [#33] (Justification)

### 5.4 [#34] (Justification)